# Dynamo graph GetStairsGeometry.dyn (Dynamo 2.12.0.5650)

code_block = CodeBlock()
# ---------- code_block.designscript (5 lines) ----------
[Point.ByCoordinates(38.627790382, 45.230575406, 0.000000000),
Point.ByCoordinates(39.961220570, 44.822904886, 0.000000000),

Point.ByCoordinates(41.294650758, 44.415234366, 0.000000000),
Point.ByCoordinates(41.539145289, 49.984064084, 0.000000000)];
# ----------------------------------------
code_block_2 = CodeBlock(a=code_block) { a; res = [a[1], a[2]]; }
code_block_3 = CodeBlock()
# ---------- code_block_3.designscript (7 lines) ----------
// dirs 1
[

Vector.ByCoordinates(-0.292371705, -0.956304756, 0.000000000, true),
Vector.ByCoordinates(0.956304756, -0.292371705, 0.000000000),
Vector.ByCoordinates(0.292371705, 0.956304756, 0.000000000),
Vector.ByCoordinates(-0.956304756, 0.292371705, 0.000000000)];
# ----------------------------------------
code_block_4 = CodeBlock(a=code_block_3) { a; res = [a[1], a[2]]; }
code_block_5 = CodeBlock()
# ---------- code_block_5.designscript (6 lines) ----------
// len 1
[
5.39698162729659,
2.78871391076115,
5.39698162729657,
2.7887139107611];
# ----------------------------------------
code_block_6 = CodeBlock(a=code_block_5) { a; res = [a[1], a[2]]; }
byStartPointDirectionLength = Line.ByStartPointDirectionLength(startPoint=code_block_2.res, direction=code_block_4.res, length=code_block_6.res)
code_block_7 = CodeBlock()
# ---------- code_block_7.designscript (6 lines) ----------
[Point.ByCoordinates(44.752809721, 53.301596164, 0.000000000)
,
Point.ByCoordinates(44.345139201, 51.968165976, 0.000000000),
Point.ByCoordinates(43.937468681, 50.634735788, 0.000000000),
Point.ByCoordinates(50.243606856, 50.164823440, 0.000000000)
];
# ----------------------------------------
code_block_8 = CodeBlock(a=code_block_7) { a; res = [a[1], a[2]]; }
code_block_9 = CodeBlock()
# ---------- code_block_9.designscript (6 lines) ----------
// dirs 2
[
Vector.ByCoordinates(-0.956304756, 0.292371705, 0.000000000),
Vector.ByCoordinates(-0.292371705, -0.956304756, 0.000000000),
Vector.ByCoordinates(0.956304756, -0.292371705, 0.000000000),
Vector.ByCoordinates(0.292371705, 0.956304756, 0.000000000)];
# ----------------------------------------
code_block_10 = CodeBlock(a=code_block_9) { a; res = [a[1], a[2]]; }
code_block_11 = CodeBlock()
# ---------- code_block_11.designscript (4 lines) ----------
[6.16797900262465,
2.78871391076115,
6.16797900262468,
2.78871391076115];
# ----------------------------------------
code_block_12 = CodeBlock(a=code_block_11) { a; res = [a[1], a[2]]; }
byStartPointDirectionLength_2 = Line.ByStartPointDirectionLength(startPoint=code_block_8.res, direction=code_block_10.res, length=code_block_12.res)
code_block_13 = CodeBlock(a=code_block) { a; res = [a[1], a[2]]; }
code_block_14 = CodeBlock(a=code_block_5) { a; res = [a[1], a[2]]; }
code_block_15 = CodeBlock(a=code_block_3) { a; res = [a[1], a[2]]; }
